# Grasshopper definition model.gh (Grasshopper 1.0.7)
# plug-ins: Human

panel = Panel("1.9375")
holes_diam = Panel("0.625")
# Brick dimensions
w = Panel("3.625")
l = Panel("7.625")
h = Panel("2.5")
search_or_deg_01 = Slider(0, range=0..90)
search_or_deg_02 = Slider(45, range=0..90)
search_or_deg_03 = Slider(45, range=0..90)
unit_rot_deg_01 = Slider(0, range=0..90)
unit_rot_deg_02 = Slider(45, range=0..90)
# ! if you want to keep one rotation value only set it to 0 !
unit_rot_deg_03 = Slider(90, range=0..90)
search_step = Slider(2, range=0..10)
max_num_courses = Slider(15, range=0..15)
min_area_overlap1 = Slider(20, range=0..100)
min_area_overlap2 = Slider(20, range=0..100)
pipeline = GeometryPipeline(
    GroupByLayer=False,
    GroupByType=False,
    IncludeHidden=True,
    IncludeLocked=True,
    LayerFilter="base_units",
    NameFilter="*",
    SublayerFiltering=True,
    TypeFilter=4)
merge = Merge(Data1=search_or_deg_01, Data2=search_or_deg_02)
merge_2 = Merge(Data1=unit_rot_deg_01, Data2=unit_rot_deg_03)

# ---- group: first course units
crv = Curve(pipeline)

# ---- group: search orientation
data = Data(merge)

# ---- group: unit rotation
data_2 = Data(merge_2)

# ---- group: search step dimension
search_step_2 = Data(search_step)

# ---- group: max num of courses
data_3 = Data(max_num_courses)

# ---- group: min overlap area 1 & 2
data_4 = Data(min_area_overlap1)
data_5 = Data(min_area_overlap2)

# ----
crv_2 = Curve([<curve referenced from the Rhino model> x10])
filer = FileHandlingInPython(py_fn="generative_stacking.py")  # -> py_fp
# ---------- filer: Python ----------
# FILE HANDLING IN GRASSHOPPER THROUGH PYTHON
# updated: 04/24/2018
import os

# get file path of current gh file
fp = ghenv.LocalScope.ghdoc.Path
print("current gh file path: {}".format(fp))

# get file directory and file name
(fd, fn) = os.path.split(fp)
print("file directory: {}".format(fd))
print("file name: {}".format(fn))
print("----")

py_fp = os.path.join(fd, "py", py_fn)
print(py_fp)
# ---------- end filer ----------
file = ReadFile(File=filer, PerLineParse=False)
python = GhPythonScript(
    Code=file,
    Geos_to_use=crv_2,
    Geos=crv,
    Rotation_degrees=data,
    Rotate_geo_degs=data_2,
    Search_step=search_step_2,
    Max_num_courses=data_3,
    Min_area_overlap1=data_4,
    Min_area_overlap2=data_5)  # -> Out, Placed_units, All_tests, Num_units_per_course, Overlapping_areas
bnd = Bounds(Numbers=python.Overlapping_areas)
panel_2 = Panel(filer)
dedomain = DeconstructDomain(Domain=bnd)  # -> Start, End
gradient = Gradient(
    LowerLimit=dedomain.Start,
    UpperLimit=dedomain.End,
    Parameter=python.Overlapping_areas,
    stops=[0: RGB(234, 38, 0), 0.25: RGB(234, 126, 0), 0.5: RGB(254, 244, 84), 0.75: RGB(173, 203, 249), 1: RGB(75, 107, 169)])  # disabled
panel_3 = Panel(python.Out)
crv_3 = Curve(python.All_tests)
partition = PartitionList(List=python.Placed_units, Size=python.Num_units_per_course)
lng = ListLength(List=python.Num_units_per_course)
number_slider = Slider(2.5, range=0..10)
crv_4 = Curve(crv)
offset = OffsetCurve(Curve=crv_4, Distance=0.25, Plane=PlaneXY(0, 0, 0), Corners=1)
series = Series(Start=number_slider, Step=number_slider, Count=lng)
Z = UnitZ(Factor=series)
move = Move(Geometry=partition, Motion=graft(Z))  # -> Geometry, Transform
previewlw = CustomPreviewLineweights(Geometry=offset, Shader=ColourSwatch(SwatchColor=RGB(255, 0, 0)), Thickness=Slider(10, range=0..10), Absolute=False)
Z_2 = UnitZ(Factor=number_slider)
extr = Extrude(Base=move.Geometry, Direction=Z_2)
extr_2 = Extrude(Base=crv_4, Direction=Z_2)
cap = CapHoles(Brep=extr)  # -> simplify(Brep)
cap_2 = CapHoles(Brep=extr_2)
number_slider_2 = Slider(-2, range=-2..15)
addition = Addition(A=number_slider_2, B=1)
geo = Geometry(simplify(move.Geometry))
preview = CustomPreview(Geometry=cap_2, Material=ColourSwatch(SwatchColor=RGB(171, 101, 101)))
geo_2 = Geometry(cap)
debrep = DeconstructBrep(Brep=cap)  # -> Faces, Edges, Vertices
python_2 = GhPythonScript(x=number_slider_2)  # -> a, b
# ---------- python_2: Python ----------
__author__ = "Lorenzo"
__version__ = "2019.04.08"

import rhinoscriptsyntax as rs

a = "{" + str(x) + "}"
b = ["{" + str(i) + "}" for i in range(int(x))]
# ---------- end python_2 ----------
geo_3 = Geometry(geo_2)
python_3 = GhPythonScript(x=addition)  # -> a
# ---------- python_3: Python ----------
__author__ = "Lorenzo"
__version__ = "2019.04.08"

import rhinoscriptsyntax as rs

a = "{" + str(x) + "}"
# ---------- end python_3 ----------
Z_3 = UnitZ(Factor=1)
swatch = ColourSwatch(SwatchColor=RGBA(212, 212, 212, 81))
join = JoinCurves(Curves=debrep.Edges, Preserve=False)
branch = TreeBranch(Tree=geo, Path=python_3, MaintainPaths=True)
branch_2 = TreeBranch(Tree=geo_3, Path=python_2.a, MaintainPaths=True)
move_2 = Move(Geometry=branch, Motion=Z_3)  # -> Geometry, Transform
branch_3 = TreeBranch(Tree=geo_2, Path=python_2.b, MaintainPaths=True)
previewlw_2 = CustomPreviewLineweights(
    Geometry=move_2.Geometry,
    Shader=ColourSwatch(SwatchColor=RGB(0, 115, 255)),
    Thickness=Slider(10, range=0..10),
    Absolute=False)
geo_4 = Geometry(cap)
preview_2 = CustomPreview(Geometry=branch_2, Material=ColourSwatch(SwatchColor=RGB(75, 181, 227)))
preview_3 = CustomPreview(Geometry=branch_3, Material=ColourSwatch(SwatchColor=RGB(209, 136, 136)))
preview_4 = CustomPreview(Geometry=flatten(cap), Material=gradient)
debrep_2 = DeconstructBrep(Brep=branch_3)  # -> Faces, Edges, Vertices
preview_5 = CustomPreview(Geometry=geo_4, Material=ColourSwatch(SwatchColor=RGB(209, 136, 136)))
createatts = CreateAttributes(LayerName="hatch", enableFullPath=False)
previewlw_3 = CustomPreviewLineweights(Geometry=join, Shader=ColourSwatch(SwatchColor=RGB(150, 150, 150)), Thickness=Slider(1, range=0..10), Absolute=False)
join_2 = JoinCurves(Curves=debrep_2.Edges, Preserve=False)
createhatch = CreateHatch(
    Bake=Toggle(False),
    Curves=branch,
    HatchPatternName="Hatch1",
    HatchScale=Slider(3, range=0..10),
    HatchRotation=Slider(45, range=0..100),
    Attributes=createatts)
delonlay = DeleteOnLayer(Run=Button(), Layer="hatch", enableFullPath=False)
previewlw_4 = CustomPreviewLineweights(Geometry=join_2, Shader=ColourSwatch(SwatchColor=RGB(150, 150, 150)), Thickness=Slider(1, range=0..10), Absolute=False)
